# Grasshopper definition objects_script.gh (Grasshopper 1.0.7)
# plug-ins: DigitalCircularityToolkit

pt = Point([<point referenced from the Rhino model> x1240])
mesh = Mesh(<mesh referenced from the Rhino model>)
brep = Brep(<brep referenced from the Rhino model>)
crv = Curve(<curve referenced from the Rhino model>)
pointcloud = ToPointCloud(Points=pt)
merge = Merge(Data1=crv, Data2=brep, Data3=mesh, Data4=pointcloud)
item = ListItem(List=merge, Index=Slider(0, range=0..3), Wrap=True)
sphereobj = SphericalObject(Geometry=item, NumSamples=50, Quantity=1, RadiusBuffer=1)  # -> Object, EffectiveSphere
obj = Object(Geometry=item, NumSamples=50)
boxobj = BoxObject(Geometry=item, NumSamples=50, Quantity=1, LengthBuffer=1, WidthBuffer=1, HeightBuffer=1)  # -> Object, EffectiveBox
lineobj = LinearObject(Geometry=item, NumSamples=50, Quantity=1, LengthBuffer=1, Area=-1)  # -> Object, EffectiveLine
planeobj = PlanarObject(Geometry=item, NumSamples=50, Quantity=1, LengthBuffer=1, WidthBuffer=1, Thickness=-1)  # -> Object, EffectivePlane
merge_2 = Merge(Data1=obj, Data2=boxobj.Object, Data3=lineobj.Object, Data4=planeobj.Object, Data5=sphereobj.Object)
item_2 = ListItem(List=merge_2, Index=Slider(0, range=0..4), Wrap=True)
objprops = ObjectProperties(Object=item_2)  # -> Centroid, PCA1, PCA2, PCA3, Length, Width, Height, BoundingBox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
